# Grasshopper definition CNC_Carving_students_version.gh (Grasshopper 1.0.7)

# Variable Thickness Slices
colour = ColourPicker(PickedColour=RGB(33, 67, 237))

# ----
# Target Surface
# (Use your own algorithm for surface generation)
number_slider = Slider(30, range=-300..100)
number_slider_2 = Slider(278, range=0..300)
number_slider_3 = Slider(275, range=0..300)
xy = XYPlane(Origin=Point(0, 0, 0))
X = UnitX(Factor=number_slider)
move = Move(Geometry=xy, Motion=X)  # -> Geometry, Transform
curvature_density = Slider(6, range=0..10)
planesrf = PlaneSurface(Plane=move.Geometry, XSize=number_slider_2, YSize=number_slider_3)
division = Division(A=number_slider_2, B=number_slider_3)
multiplication = Multiplication(A=division, B=curvature_density)
dom = ConstructDomain(DomainStart=Slider(5, range=0..10), DomainEnd=Slider(59, range=0..100))
sdivide = DivideSurface(Surface=planesrf, UCount=multiplication, VCount=curvature_density)  # -> flatten(Points), flatten(Normals), Parameters
lng = ListLength(List=sdivide.Normals)
random = Random(Range=dom, Number=lng, Seed=2)
amp = Amplitude(Vector=sdivide.Normals, Amplitude=random)
move_2 = Move(Geometry=sdivide.Points, Motion=amp)  # -> Geometry, Transform
srfgrid = SurfaceFromPoints(Points=move_2.Geometry, UCount=expr("x+1", multiplication), Interpolate=False)
crv = Curve(srfgrid)
project = Project(Geometry=crv, Plane=PlaneXY(0, 0, 0))  # -> Geometry, Transform
loft = Loft(
    Curves=[crv, project.Geometry],
    Options={Adjust=False, Closed=False, LoftEnds=0, LoftSimp=0, LoftType=0, Rebuild=10, Refit=0.01})
join = BrepJoin(Breps=[srfgrid, loft])  # -> Breps, Closed
cap = CapHoles(Brep=join.Breps)
preview = CustomPreview(
    Geometry=cap,
    Material={diffuse=RGB(221, 160, 221), emission=RGB(66, 48, 66), shine=0.5, specular=RGB(255, 255, 255), transparency=0})

playground = Panel(colour)

material_layer_height = Slider(32, range=0..100)
# Equal Thickness Slices
number_of_layers = Slider(23, range=0..50)
panel = Panel("Target surface")
xy_size_of_a_material_blank = Slider(301, range=0..1000)
series = Series(Start=0, Step=material_layer_height, Count=number_of_layers)
geo = Geometry(<brep referenced from the Rhino model>)
Y = UnitY(Factor=1)
Z = UnitZ(Factor=series)
X_2 = UnitX(Factor=1)
pl = ConstructPlane(Origin=Z, XAxis=X_2, YAxis=Y)  # disabled
Z_2 = UnitZ(Factor=material_layer_height)
rectangle = Rectangle(Plane=pl, XSize=xy_size_of_a_material_blank, YSize=xy_size_of_a_material_blank, Radius=0)  # -> Rectangle, Length
extr = Extrude(Base=rectangle.Rectangle, Direction=Z_2)
cap_2 = CapHoles(Brep=extr)
sint = SolidIntersection(BrepsA=cap_2, BrepsB=geo)
panel_2 = Panel("Even Layers")
even_layers = ColourPicker(PickedColour=RGB(0, 37, 51))
colour_2 = ColourPicker(PickedColour=RGB(39, 242, 137))

# ---- group: sort values
debrep = DeconstructBrep(Brep=sint)  # -> Faces, Edges, Vertices
item = ListItem(List=debrep.Vertices, Index=0, Wrap=True)
area = Area(Geometry=item)  # -> Area, flatten(Centroid)
pdecon = Deconstruct(Point=flatten(item))  # -> XComponent, YComponent, ZComponent
sort = SortList()  # -> Keys, ValuesA
cull = CullPattern(List=sort.Keys, CullPattern=[False, True, False, True])
cset = CreateSet(List=cull)  # -> Set, Map
mindex = MemberIndex(Set=cset.Set, Member=pdecon.ZComponent)  # -> Index, Count; disabled

# ----
dispatch = Dispatch(List=sint, DispatchPattern=mindex.Count)  # -> ListA, ListB
preview_2 = CustomPreview(Geometry=dispatch.ListB, Material=even_layers)
int = Integer(pdecon.ZComponent)
preview_3 = CustomPreview(Geometry=dispatch.ListA, Material=colour_2)

list_of_layer_s_thickneses = Panel("""3
2
7
3
7
6
3
4
4
2
7
4
5
6
3
3
2""")
xy_size_of_a_material_blank_2 = Slider(333, range=0..1000)
geo_2 = Geometry(cap)
colors_rgba = Panel("""240,157,24
240,24,222
270,16,18
119,235,19
33,67,237
35,186,186
89,145,145""")
python = GhPythonScript(list=list_of_layer_s_thickneses)  # -> acc; inputs list: list
# ---------- python: Python ----------
__author__ = "FabVR-0"
__version__ = "2020.10.30"
        
import rhinoscriptsyntax as rs
        
acc = [0]
sum = 0
for i in list:
    sum = sum + int(i)
    acc.append(sum)
# ---------- end python ----------
Y_2 = UnitY(Factor=1)
Z_3 = UnitZ(Factor=python)
X_3 = UnitX(Factor=1)
pl_2 = ConstructPlane(Origin=Z_3, XAxis=X_3, YAxis=Y_2)
Z_4 = UnitZ(Factor=list_of_layer_s_thickneses)
rectangle_2 = Rectangle(Plane=pl_2, XSize=xy_size_of_a_material_blank_2, YSize=xy_size_of_a_material_blank_2, Radius=0)  # -> Rectangle, Length
extr_2 = Extrude(Base=rectangle_2.Rectangle, Direction=Z_4)
cap_3 = CapHoles(Brep=extr_2)
lng_2 = ListLength(List=colors_rgba)

dam = DataDam(DataA=cap_3, BufferDelay=10000000, BufferMode=0)
dam_2 = DataDam(DataA=geo_2, BufferDelay=10000000, BufferMode=0)

sint_2 = SolidIntersection(BrepsA=dam, BrepsB=dam_2)
debrep_2 = DeconstructBrep(Brep=sint_2)  # -> Faces, Edges, Vertices
item_2 = ListItem(List=debrep_2.Vertices, Index=0, Wrap=True)
pdecon_2 = Deconstruct(Point=flatten(item_2))  # -> XComponent, YComponent, ZComponent
int_2 = Integer(pdecon_2.ZComponent)
sort_2 = SortList(Keys=int_2)  # -> Keys, ValuesA
int_3 = Integer(sort_2.Keys)
python_2 = GhPythonScript(x=int_3, n=lng_2, y=int_2, z=colors_rgba)  # -> encoded; inputs x: list, y: list, z: list
# ---------- python_2: Python ----------
"""Provides a scripting component.
    Inputs:
        x: Unique Z values list
        n: Number of colors
        y: All Z values
    Output:
        out: The a output variable
        dict: The a output variable"""

__author__ = "FabVR-0"
__version__ = "2020.10.30"

import ghpythonlib.treehelpers as th
import Grasshopper as gh


# split Z into y
n = int(n)

out = []
for i in range(n):
    out.append(x[i::n])

dict = {}
for i, arr in enumerate(out):
    for el in arr:
        dict[el] = z[i]

encoded = []
for i, el in enumerate(y):
    encoded.append(dict[el])
    print(dict[el])

#encoded = th.list_to_tree(encoded)
#print(encoded)


"""

"""
# ---------- end python_2 ----------
panel_4 = Panel(python_2)
col = Colour(panel_4)
preview_4 = CustomPreview(Geometry=sint_2, Material=col)
