# Grasshopper definition CNC_Carving.gh (Grasshopper 1.0.7)
# plug-ins: LunchBox, Kangaroo2 Components

panel = Panel("Height gradient SURFACE")
panel_2 = Panel("SURFACE")
colour = ColourPicker(PickedColour=RGB(255, 0, 0))

xy = XYPlane(Origin=Point(0, 0, 0))
X = UnitX(Factor=Slider(-300, range=-300..100))
number_slider = Slider(100, range=0..100)
number_slider_2 = Slider(68, range=0..100)
move = Move(Geometry=xy, Motion=X)  # -> Geometry, Transform
number_slider_3 = Slider(10, range=0..10)
division = Division(A=number_slider, B=number_slider_2)
planesrf = PlaneSurface(Plane=move.Geometry, XSize=number_slider, YSize=number_slider_2)
multiplication = Multiplication(A=division, B=number_slider_3)
explode = Explode(Curve=planesrf, Recursive=True)  # -> Segments, Vertices
item = ListItem(List=explode.Segments, Index=0, Wrap=True)
sdivide = DivideSurface(Surface=planesrf, UCount=multiplication, VCount=number_slider_3)  # -> flatten(Points), flatten(Normals), Parameters
min_curvature = Slider(1, range=0..10)
max_curvature = Slider(15, range=0..100)
crv_cp = CurveClosestPoint(Point=sdivide.Points, Curve=item)  # -> Point, Parameter, Distance
dom = ConstructDomain(DomainStart=min_curvature, DomainEnd=max_curvature)
bnd = Bounds(Numbers=crv_cp.Distance)
lng = ListLength(List=sdivide.Normals)
min_bottom_thickness = Slider(2, range=0..2)
remap = RemapNumbers(Value=crv_cp.Distance, Source=bnd, Target=Domain(0, 1))  # -> Mapped, Clipped
random = Random(Range=dom, Number=lng, Seed=2)
multiplication_2 = Multiplication(A=remap.Mapped, B=random)
addition = Addition(A=multiplication_2, B=min_bottom_thickness)
amp = Amplitude(Vector=sdivide.Normals, Amplitude=addition)
move_2 = Move(Geometry=sdivide.Points, Motion=amp)  # -> Geometry, Transform
srfgrid = SurfaceFromPoints(Points=move_2.Geometry, UCount=expr("x+1", multiplication), Interpolate=False)
crv = Curve(srfgrid)
project = Project(Geometry=crv, Plane=PlaneXY(0, 0, 0))  # -> Geometry, Transform
loft = Loft(
    Curves=[crv, project.Geometry],
    Options={Adjust=False, Closed=False, LoftEnds=0, LoftSimp=0, LoftType=0, Rebuild=10, Refit=0.01})
join = BrepJoin(Breps=[srfgrid, loft])  # -> Breps, Closed
cap = CapHoles(Brep=join.Breps)
preview = CustomPreview(
    Geometry=cap,
    Material={diffuse=RGB(221, 160, 221), emission=RGB(66, 48, 66), shine=0.5, specular=RGB(255, 255, 255), transparency=0})

number_of_layers = Slider(23, range=0..50)
# Equal Thickness Slices
material_layer_height = Slider(4, range=0..100)
panel_3 = Panel("Target surface")
xy_size_of_a_material_blank = Slider(334, range=0..1000)
playground = Panel(colour)
geo = Geometry(<brep referenced from the Rhino model>)
series = Series(Start=0, Step=material_layer_height, Count=number_of_layers)
Y = UnitY(Factor=1)
Z = UnitZ(Factor=series)
X_2 = UnitX(Factor=1)
pl = ConstructPlane(Origin=Z, XAxis=X_2, YAxis=Y)  # disabled
Z_2 = UnitZ(Factor=material_layer_height)
rectangle = Rectangle(Plane=pl, XSize=xy_size_of_a_material_blank, YSize=xy_size_of_a_material_blank, Radius=0)  # -> Rectangle, Length
extr = Extrude(Base=rectangle.Rectangle, Direction=Z_2)
cap_2 = CapHoles(Brep=extr)
sint = SolidIntersection(BrepsA=cap_2, BrepsB=geo)
panel_4 = Panel("Even Layers")
even_layers = ColourPicker(PickedColour=RGB(51, 0, 39))
colour_2 = ColourPicker(PickedColour=RGB(242, 39, 39))

X_3 = UnitX(Factor=Slider(13, range=-300..100))
xy_2 = XYPlane(Origin=Point(0, 0, 0))
number_slider_4 = Slider(300, range=0..300)
number_slider_5 = Slider(193, range=0..300)
move_3 = Move(Geometry=xy_2, Motion=X_3)  # -> Geometry, Transform
curvature_density = Slider(10, range=0..10)
planesrf_2 = PlaneSurface(Plane=move_3.Geometry, XSize=number_slider_4, YSize=number_slider_5)
division_2 = Division(A=number_slider_4, B=number_slider_5)
multiplication_3 = Multiplication(A=division_2, B=curvature_density)
dom_2 = ConstructDomain(DomainStart=Slider(0, range=0..10), DomainEnd=Slider(57, range=0..100))
sdivide_2 = DivideSurface(Surface=planesrf_2, UCount=multiplication_3, VCount=curvature_density)  # -> flatten(Points), flatten(Normals), Parameters
lng_2 = ListLength(List=sdivide_2.Normals)
random_2 = Random(Range=dom_2, Number=lng_2, Seed=2)
amp_2 = Amplitude(Vector=sdivide_2.Normals, Amplitude=random_2)
move_4 = Move(Geometry=sdivide_2.Points, Motion=amp_2)  # -> Geometry, Transform
srfgrid_2 = SurfaceFromPoints(Points=move_4.Geometry, UCount=expr("x+1", multiplication_3), Interpolate=False)
crv_2 = Curve(srfgrid_2)
project_2 = Project(Geometry=crv_2, Plane=PlaneXY(0, 0, 0))  # -> Geometry, Transform
loft_2 = Loft(
    Curves=[crv_2, project_2.Geometry],
    Options={Adjust=False, Closed=False, LoftEnds=0, LoftSimp=0, LoftType=0, Rebuild=10, Refit=0.01})
join_2 = BrepJoin(Breps=[srfgrid_2, loft_2])  # -> Breps, Closed
cap_3 = CapHoles(Brep=join_2.Breps)
preview_2 = CustomPreview(Geometry=cap_3, Material=ColourSwatch(SwatchColor=RGB(38, 0, 252)))

brep = Brep(cap_3)

# ---- group: Simulation
sdivide_3 = DivideSurface(Surface=srfgrid_2, UCount=Slider(70, range=0..100), VCount=Slider(70, range=0..100))  # -> Points, Normals, Parameters
Y_2 = Slider(15, range=0..100)
X_4 = Slider(72, range=0..100)
pln = Plane(sdivide_3.Points)
item_2 = ListItem(List=pln, Index=Y_2, Wrap=True)
item_3 = ListItem(List=flatten(item_2), Index=X_4, Wrap=True)
number_slider_6 = Slider(20, range=0..100)
cyl = Cylinder(Base=item_3, Radius=Slider(25, range=0..50), Length=Slider(40, range=0..50))
Z_3 = UnitZ(Factor=number_slider_6)
cyl_2 = Cylinder(Base=item_3, Radius=Slider(3, range=0..10), Length=number_slider_6)
move_5 = Move(Geometry=cyl, Motion=Z_3)  # -> Geometry, Transform
cap_4 = CapHoles(Brep=cyl_2)
cap_5 = CapHoles(Brep=move_5.Geometry)
bbx = BrepBrep(BrepA=cap_5, BrepB=brep)  # -> Curves, Points
panel_5 = Panel(bbx.Curves)
panel_6 = Panel(bbx.Points)
crv_3 = Curve(bbx.Curves)
patch = Patch(Curves=graft(crv_3), Spans=20, Flexibility=1, Trim=True)
preview_3 = CustomPreview(
    Geometry=crv_3,
    Material={diffuse=RGB(221, 160, 221), emission=RGB(66, 48, 66), shine=0.5, specular=RGB(255, 255, 255), transparency=0})
preview_4 = CustomPreview(
    Geometry=patch,
    Material={diffuse=RGB(221, 160, 221), emission=RGB(66, 48, 66), shine=0.5, specular=RGB(255, 255, 255), transparency=0})

# ----
swatch = ColourSwatch(SwatchColor=RGB(206, 245, 88))
preview_5 = CustomPreview(Geometry=cap_5, Material=swatch)
preview_6 = CustomPreview(Geometry=cap_4, Material=swatch)
mp = MultiPipe(
    Curves=flatten(bbx.Curves),
    NodeSize=Slider(2, range=0..10),
    EndOffset=1,
    StrutSize=1,
    Segment=0,
    KinkAngle=0.6,
    CubeFit=0,
    Caps=0)
preview_7 = CustomPreview(Geometry=mp, Material=ColourSwatch(SwatchColor=RGB(255, 69, 69)))

list_of_layer_s_thickneses = Panel("""3
3
3
3
12
8
8
4
4
12""")
xy_size_of_a_material_blank_2 = Slider(334, range=0..1000)
colors_rgba = Panel("""255,212,0
33,33,33
255,255,255
0,0,0""")
geo_2 = Geometry(cap_3)
python = GhPythonScript(list=list_of_layer_s_thickneses)  # -> acc; inputs list: list
# ---------- python: Python ----------
__author__ = "FabVR-0"
__version__ = "2020.10.30"
        
import rhinoscriptsyntax as rs
        
acc = [0]
sum = 0
for i in list:
    sum = sum + int(i)
    acc.append(sum)
# ---------- end python ----------
Y_3 = UnitY(Factor=1)
Z_4 = UnitZ(Factor=python)
X_5 = UnitX(Factor=1)
pl_2 = ConstructPlane(Origin=Z_4, XAxis=X_5, YAxis=Y_3)
rectangle_2 = Rectangle(Plane=pl_2, XSize=xy_size_of_a_material_blank_2, YSize=xy_size_of_a_material_blank_2, Radius=0)  # -> Rectangle, Length
Z_5 = UnitZ(Factor=list_of_layer_s_thickneses)
extr_2 = Extrude(Base=rectangle_2.Rectangle, Direction=Z_5)
cap_6 = CapHoles(Brep=extr_2)
lng_3 = ListLength(List=colors_rgba)

dam = DataDam(DataA=cap_6, BufferDelay=10000000, BufferMode=0)
dam_2 = DataDam(DataA=geo_2, BufferDelay=10000000, BufferMode=0)

sint_2 = SolidIntersection(BrepsA=dam, BrepsB=dam_2)
debrep = DeconstructBrep(Brep=sint_2)  # -> Faces, Edges, Vertices
item_4 = ListItem(List=debrep.Vertices, Index=0, Wrap=True)
pdecon = Deconstruct(Point=flatten(item_4))  # -> XComponent, YComponent, ZComponent
int = Integer(pdecon.ZComponent)
sort_val = SortDuplicateValues(ValueList=int)  # -> UniqueValues, Indices
sort = SortList(Keys=sort_val.UniqueValues)  # -> Keys, ValuesA
int_2 = Integer(sort.Keys)
python_2 = GhPythonScript(x=int_2, n=lng_3, y=int, z=colors_rgba)  # -> encoded; inputs x: list, y: list, z: list
# ---------- python_2: Python ----------
"""Provides a scripting component.
    Inputs:
        x: Unique Z values list
        n: Number of colors
        y: All Z values
    Output:
        out: The a output variable
        dict: The a output variable"""

__author__ = "FabVR-0"
__version__ = "2020.10.30"

import ghpythonlib.treehelpers as th
import Grasshopper as gh


# split Z into y
n = int(n)

out = []
for i in range(n):
    out.append(x[i::n])

dict = {}
for i, arr in enumerate(out):
    for el in arr:
        dict[el] = z[i]

encoded = []
for i, el in enumerate(y):
    encoded.append(dict[el])
    print(dict[el])

#encoded = th.list_to_tree(encoded)
#print(encoded)


"""

"""
# ---------- end python_2 ----------
panel_8 = Panel(python_2)
col = Colour(panel_8)
preview_8 = CustomPreview(Geometry=sint_2, Material=col)

# ---- group: sort values
debrep_2 = DeconstructBrep(Brep=sint)  # -> Faces, Edges, Vertices
item_5 = ListItem(List=debrep_2.Vertices, Index=0, Wrap=True)
area = Area(Geometry=item_5)  # -> Area, flatten(Centroid)
pdecon_2 = Deconstruct(Point=flatten(item_5))  # -> XComponent, YComponent, ZComponent

# ----
int_3 = Integer(pdecon_2.ZComponent)

# ---- group: sort values (continued)
sort_val_2 = SortDuplicateValues(ValueList=int_3)  # -> UniqueValues, Indices
sort_2 = SortList(Keys=sort_val_2.UniqueValues)  # -> Keys, ValuesA
cull = CullPattern(List=sort_2.Keys, CullPattern=[False, True, False, True])
cset = CreateSet(List=cull)  # -> Set, Map
mindex = MemberIndex(Set=cset.Set, Member=pdecon_2.ZComponent)  # -> Index, Count

# ----
dispatch = Dispatch(List=sint, DispatchPattern=mindex.Count)  # -> ListA, ListB
preview_9 = CustomPreview(Geometry=dispatch.ListB, Material=even_layers)
preview_10 = CustomPreview(Geometry=dispatch.ListA, Material=colour_2)
